% Simulink data dictionary robotModelData.sldd
% references motorParametersData.sldd

gyroToUnit = single(14.375)
accelToUnit = single(0.004)
wheelBase = single(0.19)
wheelRadius = single(0.03)
massOfCart = 0.36
CPR = 1092
MaxMotorVoltage = single(12)
massOfPendulum = 0.2
lengthToPendulumCenterOfMass = 0.058
inertiaOfPendulum = 0.001971
PPR = 13
gearReductionRatio = 42
ABPhase = 4
RobotVariantConfig = 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